# Grasshopper definition Chess+Checkers Board.gh (Grasshopper 1.0.7)

# ---- group: Input Point
pt = Point(Point(0, 0, 0))

# ----
cell_size = Slider(2, range=0..10)
cells_in_x_direction = Slider(8, range=0..20)
cells_in_y_direction = Slider(8, range=0..20)

# ---- group: Data Tree Simplified
sqgrid = Square(Plane=pt, Size=cell_size, ExtentX=cells_in_x_direction, ExtentY=cells_in_y_direction)  # -> simplify(Cells), Points

# ---- group: Culling Pattern
panel = Panel("""True
False""")

# ---- group: Chess Pieces / Cells towards the input point
item = ListItem(List=sqgrid.Cells, Index=0, Wrap=True)  # -> Item, Item1

# ---- group: Chess Pieces / Cells on the opposite end
item_2 = ListItem(List=reverse(sqgrid.Cells), Index=0, Wrap=True)  # -> Item, Item1

# ---- group: Checkers Pieces / Statement filtering for Odd/Even number of Y input
mod = Modulus(A=cells_in_y_direction, B="2")
equals = Equality(FirstNumber=mod, SecondNumber="0")  # -> Equality, Inequality

# ---- group: Chess Pieces
# 0.75 is used as base radius
# 2.5 is used as core piece height
# 1.5 is used as pawn height
# 
# Can be alterred as per once liking by attaching a number slider
merge = Merge(Data1=item.Item, Data2=item.Item1, Data3=item_2.Item, Data4=item_2.Item1)
panel_2 = Panel("0.75")

# ---- group: Chess Pieces / Chess Pieces (Conical)
panel_3 = Panel("""2.5
1.5
2.5
1.5""")
area = Area(Geometry=merge)  # -> Area, Centroid
cone = Cone(Base=area.Centroid, Radius=panel_2, Length=panel_3)  # -> Cone, Tip

# ----
series = Series(Start=0, Step="2", Count=expr("x/2", cells_in_x_direction))  # -> graft(Series)
format = Format(Format="{1}", Culture=127, Data1=series)

# ---- group: Pick alternate branch of the tree
panel_4 = Panel(format)

# ----
path = ConstructPath(Indices=panel_4)  # -> flatten(Branch)

# ---- group: Tree Split between odd & even number of branches
split = SplitTree(Data=sqgrid.Cells, Masks=flatten(path))  # -> Positive, Negative

# ---- group: Reverse cull pattern for each branch for checkered design
cull = CullPattern(List=split.Positive, CullPattern=reverse(panel))
cull_2 = CullPattern(List=split.Negative, CullPattern=panel)

# ---- group: Checkers Pieces / Cells towards input point
item_3 = ListItem(List=cull, Index=0, Wrap=True)
item_4 = ListItem(List=cull_2, Index=0, Wrap=True)  # -> Item, Item1
area_2 = Area(Geometry=item_3)  # -> Area, Centroid
area_3 = Area(Geometry=[item_4.Item, item_4.Item1])  # -> Area, Centroid

# ---- group: Checkered Pattern
boundary = BoundarySurfaces(Edges=[cull, cull_2])

# ---- group: Checkers Pieces / Cells on the opposite end (Odd Y input)
item_5 = ListItem(List=reverse(cull), Index=0, Wrap=True)  # -> Item, Item1

# ---- group: Checkers Pieces / Cells on the opposite end (Even Y input)
item_6 = ListItem(List=reverse(cull_2), Index=0, Wrap=True)  # -> Item, Item1
area_4 = Area(Geometry=[item_6.Item, item_5.Item, item_5.Item1])  # -> Area, Centroid

# ---- group: Checkers Pieces / Cells on the opposite end (Odd Y input) (continued)
area_5 = Area(Geometry=[item_5.Item, item_6.Item, item_6.Item1])  # -> Area, Centroid

# ---- group: Checkers Pieces
filter = StreamFilter(Gate=equals.Equality, Stream0=area_5.Centroid, Stream1=area_4.Centroid)
cyl = Cylinder(Base=[area_2.Centroid, area_3.Centroid, filter], Radius=0.75, Length=0.2)

# ---- group: Cap hollow cylinders
cap = CapHoles(Brep=cyl)
